# Grasshopper definition Code.gh (Grasshopper 1.0.7)
# plug-ins: LadybugGrasshopper

# ---- group: Material
mesh = Mesh(<mesh referenced from the Rhino model>)
mesh_2 = Mesh(<mesh referenced from the Rhino model>)
mesh_3 = Mesh(<mesh referenced from the Rhino model>)
mesh_4 = Mesh(<mesh referenced from the Rhino model>)
mjoin = MeshJoin(Meshes=mesh)
mjoin_2 = MeshJoin(Meshes=mesh_3)
mjoin_3 = MeshJoin(Meshes=mesh_2)
mjoin_4 = MeshJoin(Meshes=mesh_4)
python = GhPythonScript(mesh=mjoin, name="Window", sample=Toggle(True), virtual=Toggle(False), reflect="0")  # -> material; inputs mesh: Mesh, sample: Boolean, virtual: Boolean
# ---------- python: Python ----------
import Rhino.Geometry as rg
from math import sin, tan, asin

class Material:
    #---/Private methods/---
    def __init__(self, mesh, txt, bool1, bool2, num):
        self.mesh = mesh
        self.tag = txt
        self.sample = bool1
        self.virtual = bool2
        self._reflect = num
    
    def __repr__(self):
        return 'Material_object<%s>' % self.tag
    
    #---/Public function methods/---
    def reflect(self, ang_inci):
        return self._reflect

material = Material(mesh, name, sample, virtual, reflect)
# ---------- end python ----------
python_2 = GhPythonScript(mesh=mjoin_2, name="Glass", sample=Toggle(False), virtual=Toggle(False), reflect="0.08")  # -> material; inputs mesh: Mesh, sample: Boolean, virtual: Boolean; same code as python
python_3 = GhPythonScript(mesh=mjoin_3, name="Eye", sample=Toggle(True), virtual=Toggle(True), reflect="0")  # -> material; inputs mesh: Mesh, sample: Boolean, virtual: Boolean; same code as python
python_4 = GhPythonScript(mesh=mjoin_4, name="Wall", sample=Toggle(False), virtual=Toggle(False), reflect="0")  # -> material; inputs mesh: Mesh, sample: Boolean, virtual: Boolean; same code as python

# ---- group: Solar Matrix
falsestart = LBFalseStartToggle(False)
python_5 = GhPythonScript(start="2019", end="2023")  # -> Nums; inputs start: Int32, end: Int32
# ---------- python_5: Python ----------
__author__ = "ccy"
__version__ = "2022.09.02"

curr = start
Nums = []
for i in range(end - start + 1):
    Nums.append(curr)
    curr += 1
# ---------- end python_5 ----------
python_6 = GhPythonScript(start="1", end="12")  # -> Nums; inputs start: Int32, end: Int32; same code as python_5
python_7 = GhPythonScript(start="1", end="31", step="10")  # -> Nums; inputs start: Int32, end: Int32, step: Int32
# ---------- python_7: Python ----------
__author__ = "ccy"
__version__ = "2022.09.02"

from math import floor

curr = start
Nums = []
for i in range(int(floor((end - start + 1)/step))):
    Nums.append(curr)
    curr += step
# ---------- end python_7 ----------
python_8 = GhPythonScript(start="0", end="23", step="1")  # -> Nums; inputs start: Int32, end: Int32, step: Int32; same code as python_7
python_9 = GhPythonScript(start="0", end="59", step="1")  # -> Nums; inputs start: Int32, end: Int32, step: Int32; same code as python_7
python_10 = GhPythonScript()  # -> path
# ---------- python_10: Python ----------
import os
import Rhino.RhinoDoc as rrd

#---///Prepare the folder path part///---
path_3dm = rrd.ActiveDoc.Path
folder = os.path.dirname(os.path.abspath(path_3dm))
folder = folder + "\\Logs\\"

#---///Get the whole path///---
path = folder + 'Sky_Matrix.txt'
# ---------- end python_10 ----------
ashrae_sunpath = ASHRAESunPath(
    Latitude="30.67",
    Longitude="104.2",
    TimeZone="8",
    Year=python_5,
    Month=python_6,
    Day=python_7,
    Hour=python_8,
    Minute=python_9,
    path=python_10,
    gen_it=falsestart)  # -> out; inputs TimeZone: Int32, Year: list of Int32, Month: list of Int32, Day: list of Int32, Hour: list of Int32, Minute: list of Int32, gen_it: Boolean
# ---------- ashrae_sunpath: Python ----------
"""Calculate the solar angles in target times.
    Inputs:
        Latitude: The latitude number of site in degree
        Longitude: The longitude number of site in degree
        TimeZone: The time zone number of site, 0 for London, 8 for Beijing
        Month: The target months, 1 to 12, single or multiple
        Day: The target days, single or multiple
        Hour:  The target hours, single or multiple
        Taus_b: The optical depths of beam light, average of month
        Taus_d: The optical depths of diffused light, average of month
    Output:
        Recipes: The recipes including datetime and solar information"""

__author__ = "ccy"
__version__ = "2021.11.04"

import Rhino.Geometry as rg
from math import sin, asin, cos, acos, radians, degrees, pi, exp, floor
from datetime import datetime, date

#----------///Public method definitions///----------
def get_annual_day(year, month, day):
    try:
        day_now = date(year, month, day)
        day_start = date(year, 1, 1)
        day_delta = day_now - day_start
        num = day_delta.days + 1
        return num
    except:
        return None

def get_declination(n, year):
    n_0 = 79.6764 + 0.2422 * (year - 1985) - floor((year - 1985) / 4)
    t = n - n_0
    theta = 2 * pi * t / 365.2422
    delta_degree = (0.3723 + 23.2567*sin(theta) + 0.1149*sin(2*theta) - 
                    0.1712*sin(3*theta) - 0.758*cos(theta) + 
                    0.3656*cos(2*theta) + 0.0201*cos(3*theta))
    delta = radians(delta_degree)
    return delta

def get_equation_time(n):
    Tau = radians(360 * (n - 1) / 365)
    ET = 2.2918 * (0.0075 + 0.1868*cos(Tau) - 3.2077*sin(Tau) -
         1.4615*cos(2*Tau) - 4.089*sin(2*Tau))
    return ET

def get_hour_angle(LST, LON, LSM, ET):
    AST = LST + ET/60 + (LON - LSM)/15
    H = radians(15 * (AST - 12))
    return H

def get_solar_position(lat, declin, h):
    lat = radians(lat)
    #---/Find the solar altitude angle in radians/---
    sin_alt = sin(lat) * sin(declin) + cos(lat) * cos(declin) * cos(h)
    alt_rad = asin(sin_alt)
    
    #---/Find the solar azimuth angle in radians/---
    sin_azi = cos(declin) * sin(h) / cos(alt_rad)
    cos_azi = ((cos(h) * cos(declin) * sin(lat) - sin(declin) * cos(lat)) /
             cos(alt_rad))
    sun_vect = rg.Vector3d(-sin_azi, -cos_azi, 0)
    azi_rad = rg.Vector3d.VectorAngle(-rg.Vector3d.YAxis, sun_vect,
                   rg.Plane(rg.Point3d.Origin, -rg.Vector3d.ZAxis))
    if azi_rad > pi:
        azi_rad -= pi * 2
    #---/treat the results/---
    pln_ref = rg.Plane(rg.Point3d.Origin, sun_vect, rg.Vector3d.ZAxis)
    sun_vect.Rotate(alt_rad, pln_ref.ZAxis)
    sun_vect.Unitize()
    alt_deg = degrees(alt_rad)
    azi_deg = degrees(azi_rad)
    return alt_deg, azi_deg, sun_vect

def get_txt(mon, day, hr, min, alt, azi, vect):
    txt_mon = _treat_date(mon)
    txt_day = _treat_date(day)
    txt_hr = _treat_date(hr)
    txt_min = _treat_date(min)
    txt_timestamp = txt_mon + '/' + txt_day + '/' + txt_hr + '/' + txt_min
    Lst_num_vect = [str(vect.X), str(vect.Y), str(vect.Z)]
    txt_vect = ','.join(Lst_num_vect)
    txt_alt = str(round(alt, 2))
    txt_azi = str(round(azi, 2))
    txt = ('T' + txt_timestamp + '_ALT' + txt_alt + '_AZI' + txt_azi +
           '_V' +  txt_vect)
    return txt

#----------///Private method definitions///----------
def _treat_date(num):
    if num < 10:
        txt = '0' + str(num)
    else:
        txt = str(num)
    return txt

#----------///Main///----------
if gen_it and path:
    #---/Calculate constant values/---
    LSM = 15 * TimeZone
    
    #---/Iterate the months/---
    Lst_txt = []
    for mon in Month:
        #---/Iterate the days/---
        for day in Day:
            #---/Calculate the solar decilination angle at the day/---
            is_dd_valid = True
            Declins = []
            for year in Year:
                doy = get_annual_day(year, mon, day)
                if doy:
                    declin = get_declination(doy, year)
                    Declins.append(declin)
                else:
                    is_dd_valid = False
                    break
            if is_dd_valid:
                declin_mean = sum(Declins) / len(Declins)
                ET = get_equation_time(doy)
                #---/Iterate the hours/---
                for hour in Hour:
                    #---/Iterate the minute/---
                    for min in Minute:
                        hour_lst = hour + min/60
                        ang_hour = get_hour_angle(hour_lst, Longitude, LSM, ET)
                        [alt, azi, vect] = get_solar_position(Latitude, declin,
                                                              ang_hour)
                        if alt >= 10:
                            txt = get_txt(mon, day, hour, min, alt, azi, vect)
                            Lst_txt.append(txt)
    
    #---/write the sky matrix information/---
    txt_write = '\n'.join(Lst_txt)
    with open(path, 'w') as file:
        file.write(txt_write)
# ---------- end ashrae_sunpath ----------

# ----
merge = Merge(Data1=python, Data2=python_3, Data3=python_2)

# ---- group: Scene
falsestart_2 = LBFalseStartToggle(False)
python_11 = GhPythonScript()  # -> shield
# ---------- python_11: Python ----------
__author__ = "ccy"
__version__ = "2023.03.06"

import Rhino.Geometry as rg
from math import radians, pi

#----------///Class definitions///----------
class Shield:
    #---///Private methods///---
    def __init__(self, vect_ref, Vects_15, Vects_30):
        self._vect_ref = vect_ref
        self._Vects_15_store = Vects_15
        self._Vects_30_store = Vects_30
    
    def __repr__(self):
        return 'shield_object<%s Vectors>' % str(len(self._Vects_15_store) + 
                                                 len(self._Vects_30_store))
    
    #---///Public methods///---
    def equip(self, vect_ref):
        trans = rg.Transform.Rotation(self._vect_ref, vect_ref,
                                             rg.Point3d.Origin)
        Vects_15 = []
        for vect_store in self._Vects_15_store:
            vect_15 = rg.Vector3d(vect_store)
            vect_15.Transform(trans)
            Vects_15.append(vect_15)
        Vects_30 = []
        for vect_store in self._Vects_30_store:
            vect_30 = rg.Vector3d(vect_store)
            vect_30.Transform(trans)
            Vects_30.append(vect_30)
        return Vects_15, Vects_30

#----------///Public method definitions///----------
def get_Vects(vect_ini, pto, deg_start, deg_end):
    Vects = []
    for deg in range(deg_start, deg_end):
        vect_col = _rotate_vect(vect_ini, deg, rg.Vector3d.XAxis)
        for deg_sub in range(-89, 90):
            vect = _rotate_vect(vect_col, deg_sub, rg.Vector3d.ZAxis)
            Vects.append(vect)
    return Vects

#----------///Private method definitions///----------
def _rotate_vect(vect_in, deg, axis):
    vect = rg.Vector3d(vect_in)
    rad = radians(deg)
    vect.Rotate(rad, axis)
    return vect

#----------///Main///----------
vect_Y = rg.Vector3d.YAxis
Vects_30_b = get_Vects(vect_Y, rg.Point3d.Origin, -30, -14)
Vects_15 = get_Vects(vect_Y, rg.Point3d.Origin, -14, 15)
Vects_30 = get_Vects(vect_Y, rg.Point3d.Origin, 15, 31)
Vects_30.extend(Vects_30_b)
shield = Shield(vect_Y, Vects_15, Vects_30)
# ---------- end python_11 ----------
python_12 = GhPythonScript(shield=python_11, Materials=merge, gen_it=falsestart_2)  # -> scene, Checks; inputs Materials: list, gen_it: Boolean
# ---------- python_12: Python ----------
import Rhino.Geometry as rg
import scriptcontext as sc
from math import cos
import ghpythonlib.parallel

#----------///The class definitions///----------
class Scene:
    #---/Private methods/---
    def __init__(self):
        self._archive_r = {}
        self._archive_v = {}
        self._library = {}
    
    def __repr__(self):
        return 'scene_object'
    
    #---/Public function methods/---
    def calc_reflection(self, tag, ang_inci):
        reflect = self._library[tag].reflect(ang_inci)
        return reflect
    
    #---/Public getters/---
    def get_Panels(self):
        Panels_all = []
        Panels_r = self._archive_r.values()
        Panels_all.extend(Panels_r)
        Panels_v = self._archive_v.values()
        Panels_all.extend(Panels_v)
        return Panels_all
    
    def get_panel(self, idx): #Used in sync_panel for ray
        return self._archive_r[idx]
    
    def get_panel_both(self, idx, bool):
        if bool:
            return self._archive_v[idx]
        else:
            return self._archive_r[idx]
    
    def get_mesh(self):
        return self._mesh_r
    
    def get_mesh_both(self, bool):
        if bool:
            return self._mesh_v
        else:
            return self._mesh_r
    
    #---/Public setters/---
    def add_Meshes(self, mesh_r, mesh_v):
        self._mesh_r = mesh_r
        self._mesh_v = mesh_v
    
    def add_panel(self, idx_panel, obj_panel, bool):
        if bool:
            self._archive_v[idx_panel] = obj_panel
        else:
            self._archive_r[idx_panel] = obj_panel
    
    def add_material(self, tag, obj_material):
        self._library[tag] = obj_material

class Panel:
    #---/Private methods/---
    def __init__(self, idx, tag, sample, virtual):
        self._idx = idx
        self._tag = tag
        self._sample = sample
        self.virtual = virtual
    
    def __repr__(self):
        return '%s_object_<%s>' % (self._tag, self._idx)
    
    #---/Public function methods/---
    def prepare(self, shield):
        mesh = scene.get_mesh_both(self.virtual)
        face = mesh.Faces[self._idx]
        if face.IsQuad:
            self._vect = mesh.NormalAt(self._idx, 0.5, 0, 0.5, 0)
            self._pt = mesh.PointAt(self._idx, 0.5, 0, 0.5, 0)
        else:
            self._vect = mesh.NormalAt(self._idx, 0.33, 0.33, 0.34, 0)
            self._pt = mesh.PointAt(self._idx, 0.33, 0.33, 0.34, 0)
        #Checks.append(self._pt)
        if self._sample:
            #-/Get basic information/-
            #-/Rotate the vector matrix to the location/
            [Vects_15, Vects_30] = shield.equip(self._vect)
            self._Vects = {}
            for idx_15, vect_15 in enumerate(Vects_15):
                tag = '15#' + str(idx_15)
                self._Vects[tag] = vect_15
            for idx_30, vect_30 in enumerate(Vects_30):
                tag = '30#' + str(idx_30)
                self._Vects[tag] = vect_30
            
        else:
            self._Vects_15 = []
            self._Vects_30 = []
    
    def is_window(self):
        if self._sample:
            return True
        else:
            return False
    
    #---/Public getters/---
    def get_pt(self):
        return self._pt
    
    def get_norm(self):
        return self._vect
    
    def get_Vects(self):
        return self._Vects
    
    def get_idx(self):
        return self._idx
    
    def get_tag(self):
        return self._tag

#----------///The function definitions///----------
def get_Lns(pt, Vects):
    Lns = []
    for vect in Vects:
        ln = rg.Line(pt, vect * 10)
        Lns.append(ln)
    return Lns

def prepare_panel(panel):
    panel.prepare(shield)

if gen_it:
    #---/Get the system accuracy (normally 0.001)/---
    TOL = sc.doc.ModelAbsoluteTolerance
    Checks = []
    
    #---/Initiate the scene object/---
    scene = Scene()
    idx_panel = 0
    idx_virtual = 0
    mesh_real = rg.Mesh()
    mesh_virtual = rg.Mesh()
    
    #---/Iterate meshes & initiate the panel objects/---
    for material in Materials:
        mesh = material.mesh
        tag = material.tag
        sample = material.sample
        virtual = material.virtual
        if virtual:
            for idx_face in range(mesh.Faces.Count):
                panel = Panel(idx_virtual, tag, sample, virtual)
                scene.add_panel(idx_virtual, panel, virtual)
                idx_virtual += 1
            mesh_virtual.Append(mesh)
        else:
            scene.add_material(tag, material)
            for idx_face in range(mesh.Faces.Count):
                panel = Panel(idx_panel, tag, sample, virtual)
                scene.add_panel(idx_panel, panel, virtual)
                idx_panel += 1
            mesh_real.Append(mesh)
    scene.add_Meshes(mesh_real, mesh_virtual)
    
    #---/Iterate dictionary keys parallely and prepare panels/---
    ghpythonlib.parallel.run(prepare_panel, scene.get_Panels(), False)
# ---------- end python_12 ----------

# ---- group: Ray-Trace
falsestart_3 = LBFalseStartToggle(False)
python_13 = GhPythonScript()  # -> path
# ---------- python_13: Python ----------
import os
import Rhino.RhinoDoc as rrd

#---///Prepare the folder path part///---
path_3dm = rrd.ActiveDoc.Path
folder = os.path.dirname(os.path.abspath(path_3dm))
folder = folder + "\\Logs\\"

#---///Get the whole path///---
path = folder + 'Log.txt'
# ---------- end python_13 ----------
python_14 = GhPythonScript(path=python_13, scene=python_12.scene, run_it=falsestart_3)  # -> out; inputs run_it: Boolean
# ---------- python_14: Python ----------
import Rhino.Geometry as rg
import scriptcontext as sc
from System import Array
import clr
import ghpythonlib.parallel

#----------///The class definitions///----------
class Ray:
    #---/Private methods/---
    def __init__(self, idx_panel, bool, pt_in, vect, tag, portion):
        pt = rg.Point3d(pt_in)
        self.virtual = bool
        self._Pts = [pt]
        self._Vects = [vect]
        self._portion = [portion]
        self._status = 1 #The ray is waiting to be initiated
        self._tag = 'A' + tag
        self._Idcs_face = [[idx_panel]]
    
    #---/Private function methods/---
    def _sync_panel(self, Lst, vect_ray):
        #-/Read information from the scene archive by indices/-
        valid = False
        vect = rg.Vector3d.Zero
        Lst_tag = []
        for idx in Lst:
            panel = scene.get_panel(idx)
            vect_panel = panel.get_norm()
            if vect_panel * vect_ray < 0:
                valid = True
                vect += vect_panel
                tag = panel.get_tag()
                if not tag in Lst_tag:
                    Lst_tag.append(tag)
        if valid:
            vect.Unitize()
            tag = Lst_tag[0]
            return vect, tag
        else:
            #-/Turn to the terminating routine/-
            self._status = -1 #Ray get lost
            return None, None
    
    #---/Public function methods/---
    def forward(self, mesh):
        #-/Prepare the basic forward recipe/-
        adjust = TOL
        Idcs = clr.StrongBox[Array[int]]()
        Lst_idx = []
        pt = self._Pts[-1]
        vect = self._Vects[-1]
        pt_start = pt + vect * adjust
        
        #-/Initial forward to see if missed anything/-
        ray = rg.Ray3d(pt_start, -vect)
        dist = rg.Intersect.Intersection.MeshRay(mesh, ray, Idcs)
        Lst_check = list(Idcs.Value)
        if (dist > 0 and dist < vect.Length * adjust and
                       Lst_check != self._Idcs_face[-1]):
            #-/Really missed something/-
            pt_new = pt_start - vect * dist
            Lst_idx.extend(Lst_check)
        else:
            #-/Not missing anything/-
            ray = rg.Ray3d(pt_start, vect)
            dist = rg.Intersect.Intersection.MeshRay(mesh, ray, Idcs)
            if dist > 0:
                pt_new = pt_start + vect * dist
                Lst_idx.extend(list(Idcs.Value))
            else:
                #-/Turn to the terminating routine/-
                self._status = -1 #Ray get lost
                dist = 20
                pt_new = pt_start + vect * dist
        return pt_new, Lst_idx
    
    def reflect(self, mesh, pt, Lst_idx):
        if self._status == 1:
            #-/The ray is on going or is waiting to be initiated/-
            #-/Attract information from the panels/-
            [vect_norm, tag] = self._sync_panel(Lst_idx, self._Vects[-1])
            
            if self.is_valid():
                #-/Calculate the incident angle/-
                pln = rg.Plane(pt, vect_norm, -self._Vects[-1])
                rad = rg.Vector3d.VectorAngle(vect_norm, -self._Vects[-1], pln)
                reflect = scene.calc_reflection(tag, rad)
                self._portion.append(self._portion[-1] * reflect)
            if self.is_valid():
                #-/Reflection/-
                vect_cross = rg.Vector3d.CrossProduct(vect_norm,
                                               -self._Vects[-1])
                pln = rg.Plane(pt, vect_norm, vect_cross)
                trans = rg.Transform.Mirror(pln)
                vect_reflect = rg.Vector3d(-self._Vects[-1])
                vect_reflect.Transform(trans)
                
                #-/Record this reflection for the next forward/-
                self._Vects.append(vect_reflect)
            
            #-/Record the last forward
            self._Pts.append(pt)
            self._Idcs_face.append(Lst_idx)
        elif self._status == -1:
            #-/The ray get lost in the last forwarding/-
            #-/Terminating the ray with appending the last points/-
            self._Pts.append(pt)
    
    #---/Public getters/---
    def is_valid(self):
        if self._status == 1 and self._portion[-1] > 0.001:
            return True
        else:
            return False
    
    def get_tag(self):
        return self._tag
    
    def get_Idcs(self):
        Lst_txt = []
        for Lst_idx in self._Idcs_face:
            Lst_txt_sub = []
            for idx in Lst_idx:
                Lst_txt_sub.append(str(idx))
            txt_sub = '^'.join(Lst_txt_sub)
            Lst_txt.append(txt_sub)
        return Lst_txt
    
    def get_plc(self): #for test
        if self._Pts and len(self._Pts) > 1:
            plc = rg.PolylineCurve(self._Pts)
            return plc
        else:
            return self._Pts
    
    def get_portion(self):
        port_last = self._portion[-1]
        num = round(port_last, 4)
        txt = str(num)
        return txt
    
    def get_vect(self):
        vect = self._Vects[-1]
        Lst_num = [str(vect.X), str(vect.Y), str(vect.Z)]
        txt = ','.join(Lst_num)
        return txt

#----------///The function definitions///----------
def ray_shoot(ray):
    #-/Normal routine, if not valid, will be passed/-
    count = 0
    while ray.is_valid() and count < 10:
        [pt_hit, Idcs_face] = ray.forward(MESH)
        ray.reflect(MESH, pt_hit, Idcs_face)
        count += 1
    
    #-/Collect log information/-
    txt_tag = ray.get_tag()
    txt_panel = ','.join(ray.get_Idcs())
    txt_portion = ray.get_portion()
    txt_vect = ray.get_vect()
    if ray.virtual:
        txt_vr = '_PV'
    else:
        txt_vr = '_PR'
    txt = txt_tag + txt_vr + txt_panel + '_%' + txt_portion + '_V' + txt_vect
    return txt

#----------///Main///----------
def Main(panel):
    if panel.is_window():
        Lst_log = []
        #Plcs = []
        
        #-/The original rays for reflections/-
        dict_Vects = panel.get_Vects()
        pt = panel.get_pt()
        idx = panel.get_idx()
        virtual = panel.virtual
        for tag in dict_Vects.keys():
            #-/Declare a new ray/-
            vect = dict_Vects[tag]
            ray = Ray(idx, virtual, pt, vect, tag, 1.0)
            #-/Ray-trace routine/-
            txt = ray_shoot(ray)
            Lst_log.append(txt)
            #plc = ray.get_plc()
            #Plcs.append(plc)
        
        #-/Summary/-
        txt_sum = '\n'.join(Lst_log)
    else:
        txt_sum = ''
        #Plcs = []
    return txt_sum

if run_it and scene:
    #---/Get the system accuracy (normally 0.001)/---
    TOL = sc.doc.ModelAbsoluteTolerance
    
    #---/initialize this run/---
    MESH = scene.get_mesh()
    
    #---/Proceed Ray-Tracing in parallel/---
    Logs = ghpythonlib.parallel.run(Main, scene.get_Panels(), False)
    with open(path, 'w') as file:
        for txt_log in Logs:
            if txt_log:
                file.write(txt_log)
                file.write('\n')
# ---------- end python_14 ----------

# ---- group: R-Tree
# Only run after ray-trace & solar matrix!!!
falsestart_4 = LBFalseStartToggle(False)
python_15 = GhPythonScript()  # -> folder
# ---------- python_15: Python ----------
import os
import Rhino.RhinoDoc as rrd

#---///Prepare the folder path part///---
path_3dm = rrd.ActiveDoc.Path
folder = os.path.dirname(os.path.abspath(path_3dm))
folder = folder + "\\Results\\"
# ---------- end python_15 ----------
python_16 = GhPythonScript(
    path_ray=python_13,
    path_mtx=python_10,
    scene=python_12.scene,
    tol_ang="0.5",
    factor="10",
    folder=python_15,
    run_it=falsestart_4)  # -> out; inputs run_it: Boolean
# ---------- python_16: Python ----------
__author__ = "ccy"
__version__ = "2023.03.07"

import Rhino.Geometry as rg
from math import radians, sin, e, pi
import ghpythonlib.parallel

#----------///Class definitions///----------
class Pointer:
    #---/Private methods/---
    def __init__(self, idx1, idx2, txt, num, sphere):
        self._idx_panel = idx1
        self._idx_ray = idx2
        self._ang_lv = txt
        self._tag = self._ang_lv + '_' + str(self._idx_ray)
        self._portion = num
        self.sphere = sphere
    
    def __repr__(self):
        txt = 'pointer_object_<P%s_' % self._idx_panel + self._tag + '>'
        return txt
    
    #---/Public function methods/---
    def calc_bright(self, alt):
        h = radians(alt)
        E = 1.37 * 100000 * pow(e, -0.223/sin(h))
        B = self._portion * E / pi
        return B
    
    def calc_grade(self, B):
        if self._ang_lv == '15':
            if B < 1500:
                grade = 'A'
            elif B < 2000:
                grade = 'B'
            else:
                grade = 'C'
        else:
            if B < 2000:
                grade = 'A'
            elif B < 4000:
                grade = 'B'
            else:
                grade = 'C'
        return grade
    
    #---/Public getters/---
    def get_idx_panel(self):
        return self._idx_panel
    
    def get_tag(self):
        return self._tag

class Sky:
    #---/Private methods/---
    def __init__(self, idx, txt, alt):
        self._idx = idx
        self._timestamp = txt
        self.alt = alt
    
    def __repr__(self):
        txt = 'sky_object_' + self._timestamp + '_<ALT%s>' % self.alt
        return txt
    
    #---/Public getters/---
    def get_timestamp(self):
        return self._timestamp

class Panel:
    #---/Private methods/---
    def __init__(self, idx):
        self._idx = idx
        self._dict_time = {}
    
    def __repr__(self):
        return 'panel_object_<%s>' % self._idx
    
    #---/Public function methods/---
    def add_to_dict(self, key, value):
        if key in self._dict_time.keys():
            self._dict_time[key].append(value)
        else:
            self._dict_time[key] = [value]
    
    def gen_info_txt(self):
        Lst_timestamp = self._dict_time.keys()
        Lst_timestamp.sort()
        Lst_txt_result = []
        Lst_txt_reshoot = []
        for timestamp in Lst_timestamp:
            [result, Lst_reshoot] = _resort_result(self._dict_time[timestamp])
            txt = timestamp + '_' + result
            Lst_txt_result.append(txt)
            Lst_txt_reshoot.extend(Lst_reshoot)
        txt_result = '\n'.join(Lst_txt_result)
        Lst_txt_reshoot = list(set(Lst_txt_reshoot))
        Lst_txt_reshoot.sort()
        txt_reshoot = '\n'.join(Lst_txt_reshoot)
        return txt_result, txt_reshoot

#----------///Public method definitions///----------
def get_tree(path, pto, dist):
    #-/Read the data/-
    with open(path, 'r') as file:
        Lst_txt = file.readlines()
    
    #-/Initiate the tree/-
    tree = rg.RTree()
    Skys = []
    for idx, txt in enumerate(Lst_txt):
        Lst_data = txt.split('_')
        
        #-/Filling points to the space tree/-
        vect = _get_vect(Lst_data[-1])
        pt = pto + vect * dist
        tree.Insert(pt, idx)
        
        #-/Filling the skys/-
        timestamp = _get_timestamp(Lst_data[0])
        alt = _get_alt(Lst_data[1])
        sky = Sky(idx, timestamp, alt)
        Skys.append(sky)
    return tree, Skys

def get_Spheres(path, pto, dist, deg):
    #-/Read the data/-
    with open(path, 'r') as file:
        Lst_txt = file.readlines()
    
    #-/Generating the spheres/-
    radius = radians(deg) * dist
    Pointers = []
    for txt in Lst_txt:
        Lst_data = txt.split('_')
        portion = _get_portion(Lst_data[2])
        if portion > 0.001 and portion < 1:
            [lv_ang, idx_ray] = _get_angle_level(Lst_data[0])
            idx_panel = _get_idx_panel(Lst_data[1])
            vect = _get_vect(Lst_data[-1])
            pt = pto + vect * dist
            sphere = rg.Sphere(pt, radius)
            pointer = Pointer(idx_panel, idx_ray, lv_ang, portion, sphere)
            Pointers.append(pointer)
    return Pointers

def Match(pointer):
    #---///Define the space tree searching method///---
    def _SearchCallback(sender, e):
        Lst_idx_sky.append(e.Id)
    
    #---///Searching and filling information to panels///---
    Lst_idx_sky = []
    tree_sky.Search(pointer.sphere, _SearchCallback, Lst_idx_sky)
    if Lst_idx_sky:
        for idx_sky in Lst_idx_sky:
            #-/Calculate the brightness/-
            sky = Skys[idx_sky]
            brt = pointer.calc_bright(sky.alt)
            grade = pointer.calc_grade(brt)
            
            #-/Fill information to the panel/-
            tag = pointer.get_tag()
            timestamp = sky.get_timestamp()
            txt_info = tag + '_' + grade + '_' + str(brt)
            panel = dict_panel[pointer.get_idx_panel()]['panel']
            panel.add_to_dict(timestamp, txt_info)

#----------///Private method definitions///----------
def _get_portion(txt):
    txt = txt.replace('%', '')
    num = float(txt)
    return num

def _get_angle_level(txt):
    txt = txt.replace('A', '')
    Lst_txt = txt.split('#')
    txt_out = Lst_txt[0]
    num_out = int(Lst_txt[1])
    return txt_out, num_out

def _get_idx_panel(txt):
    txt = txt.replace('P', '')
    Lst_txt = txt.split(',')
    txt_out = Lst_txt[0]
    return txt_out

def _get_vect(txt):
    txt = txt.replace('V', '')
    Lst_txt = txt.split(',')
    x = float(Lst_txt[0])
    y = float(Lst_txt[1])
    z = float(Lst_txt[2])
    vect = rg.Vector3d(x, y, z)
    return vect

def _get_timestamp(txt):
    txt = txt.replace('T', '')
    return txt

def _get_alt(txt):
    txt = txt.replace('ALT', '')
    num = float(txt)
    return num

def _resort_result(Lst_txt):
    result = 'A'
    Lst_txt_out = []
    for txt in Lst_txt:
        Lst_data = txt.split('_')
        level = Lst_data[0]
        idx = Lst_data[1]
        grade = Lst_data[2]
        if grade > result:
            result = grade
        txt_out = '_'.join([grade, level, idx])
        Lst_txt_out.append(txt_out)
    return result, Lst_txt_out

#----------///Main///----------
def Main(idx_panel):
    #---///Run in parallel///---
    Pointers = dict_panel[idx_panel]['Pointers']
    ghpythonlib.parallel.run(Match, Pointers, False)
    
    #---///Write the panel information///---
    path_write1 = folder + 'Result_Panel_' + idx_panel + '.txt'
    path_write2 = folder + 'Reshoot_Panel_' + idx_panel + '.txt'
    panel = dict_panel[idx_panel]['panel']
    [txt_result, txt_reshoot] = panel.gen_info_txt()
    with open(path_write1, 'w') as file_write:
        file_write.write(txt_result)
    with open(path_write2, 'w') as file_write:
        file_write.write(txt_reshoot)

if run_it and scene:
    #---///Initiate the objects///---
    pto = rg.Point3d.Origin
    [tree_sky, Skys] = get_tree(path_mtx, pto, factor)
    Pointers = get_Spheres(path_ray, pto, factor, tol_ang)
    
    #---///Build the dictionary of panels///---
    dict_panel = {}
    Panels_ref = scene.get_Panels()
    for panel_ref in Panels_ref:
        if panel_ref.is_window():
            if panel_ref.virtual:
                idx_panel = 'V' + str(panel_ref.get_idx())
            else:
                idx_panel = 'R' + str(panel_ref.get_idx())
            dict_panel[idx_panel] = {'panel': Panel(idx_panel), 
                                     'Pointers': []}
    
    #---///Insert the pointers into the panel dictionary///---
    for pointer in Pointers:
        dict_panel[pointer.get_idx_panel()]['Pointers'].append(pointer)
    
    #---///Start iterating in parallel///---
    for idx_panel in dict_panel.keys():
        Main(idx_panel)
# ---------- end python_16 ----------

# ---- group: Check ur Rays
python_17 = GhPythonScript(start="0", end="0")  # -> Nums; inputs start: Int32, end: Int32; same code as python_5
python_18 = GhPythonScript(virtual=Toggle(True), Idcs_panel=python_17)  # -> Paths; inputs virtual: Boolean, Idcs_panel: list of Int32
# ---------- python_18: Python ----------
import os
import Rhino.RhinoDoc as rrd

#---///Prepare the folder path part///---
path_3dm = rrd.ActiveDoc.Path
folder = os.path.dirname(os.path.abspath(path_3dm))
if virtual:
    tag_panel = 'V'
else:
    tag_panel = 'R'
Paths = []
for idx_panel in Idcs_panel:
    path = folder + "\\Results\\Reshoot_Panel_" + tag_panel + str(idx_panel) + '.txt'
    Paths.append(path)
# ---------- end python_18 ----------
falsestart_5 = LBFalseStartToggle(False)
python_19 = GhPythonScript(Paths=python_18, level="A", scene=python_12.scene, run_it=falsestart_5)  # -> out, Rays_all; inputs Paths: list, run_it: Boolean
# ---------- python_19: Python ----------
import Rhino.Geometry as rg
import scriptcontext as sc
from System import Array
import clr
import ghpythonlib.parallel

#----------///The class definitions///----------
class Ray:
    #---/Private methods/---
    def __init__(self, idx_panel, pt_in, vect, tag, portion):
        pt = rg.Point3d(pt_in)
        self._Pts = [pt]
        self._Vects = [vect]
        self._portion = [portion]
        self._status = 1 #The ray is waiting to be initiated
        self._tag = 'A' + tag
        self._Idcs_face = [[idx_panel]]
    
    #---/Private function methods/---
    def _sync_panel(self, Lst, vect_ray):
        #-/Read information from the scene archive by indices/-
        valid = False
        vect = rg.Vector3d.Zero
        Lst_tag = []
        for idx in Lst:
            panel = scene.get_panel(idx)
            vect_panel = panel.get_norm()
            if vect_panel * vect_ray < 0:
                valid = True
                vect += vect_panel
                tag = panel.get_tag()
                if not tag in Lst_tag:
                    Lst_tag.append(tag)
        if valid:
            vect.Unitize()
            tag = Lst_tag[0]
            return vect, tag
        else:
            #-/Turn to the terminating routine/-
            self._status = -1 #Ray get lost
            return None, None
    
    #---/Public function methods/---
    def forward(self, mesh):
        #-/Prepare the basic forward recipe/-
        adjust = TOL
        Idcs = clr.StrongBox[Array[int]]()
        Lst_idx = []
        pt = self._Pts[-1]
        vect = self._Vects[-1]
        pt_start = pt + vect * adjust
        
        #-/Initial forward to see if missed anything/-
        ray = rg.Ray3d(pt_start, -vect)
        dist = rg.Intersect.Intersection.MeshRay(mesh, ray, Idcs)
        Lst_check = list(Idcs.Value)
        if (dist > 0 and dist < vect.Length * adjust and
                       Lst_check != self._Idcs_face[-1]):
            #-/Really missed something/-
            pt_new = pt_start - vect * dist
            Lst_idx.extend(Lst_check)
        else:
            #-/Not missing anything/-
            ray = rg.Ray3d(pt_start, vect)
            dist = rg.Intersect.Intersection.MeshRay(mesh, ray, Idcs)
            if dist > 0:
                pt_new = pt_start + vect * dist
                Lst_idx.extend(list(Idcs.Value))
            else:
                #-/Turn to the terminating routine/-
                self._status = -1 #Ray get lost
                dist = 20
                pt_new = pt_start + vect * dist
        return pt_new, Lst_idx
    
    def reflect(self, mesh, pt, Lst_idx):
        if self._status == 1:
            #-/The ray is on going or is waiting to be initiated/-
            #-/Attract information from the panels/-
            [vect_norm, tag] = self._sync_panel(Lst_idx, self._Vects[-1])
            
            if self.is_valid():
                #-/Calculate the incident angle/-
                pln = rg.Plane(pt, vect_norm, -self._Vects[-1])
                rad = rg.Vector3d.VectorAngle(vect_norm, -self._Vects[-1], pln)
                reflect = scene.calc_reflection(tag, rad)
                self._portion.append(self._portion[-1] * reflect)
            if self.is_valid():
                #-/Reflection/-
                vect_cross = rg.Vector3d.CrossProduct(vect_norm,
                                               -self._Vects[-1])
                pln = rg.Plane(pt, vect_norm, vect_cross)
                trans = rg.Transform.Mirror(pln)
                vect_reflect = rg.Vector3d(-self._Vects[-1])
                vect_reflect.Transform(trans)
                
                #-/Record this reflection for the next forward/-
                self._Vects.append(vect_reflect)
            
            #-/Record the last forward
            self._Pts.append(pt)
            self._Idcs_face.append(Lst_idx)
        elif self._status == -1:
            #-/The ray get lost in the last forwarding/-
            #-/Terminating the ray with appending the last points/-
            self._Pts.append(pt)
    
    #---/Public getters/---
    def is_valid(self):
        if self._status == 1 and self._portion[-1] > 0.001:
            return True
        else:
            return False
    
    def get_tag(self):
        return self._tag
    
    def get_Idcs(self):
        Lst_txt = []
        for Lst_idx in self._Idcs_face:
            Lst_txt_sub = []
            for idx in Lst_idx:
                Lst_txt_sub.append(str(idx))
            txt_sub = '^'.join(Lst_txt_sub)
            Lst_txt.append(txt_sub)
        return Lst_txt
    
    def get_plc(self): #for test
        if self._Pts and len(self._Pts) > 1:
            plc = rg.PolylineCurve(self._Pts)
            return plc
        else:
            return self._Pts
    
    def get_portion(self):
        port_last = self._portion[-1]
        num = round(port_last, 4)
        txt = str(num)
        return txt
    
    def get_vect(self):
        vect = self._Vects[-1]
        Lst_num = [str(vect.X), str(vect.Y), str(vect.Z)]
        txt = ','.join(Lst_num)
        return txt

#----------///The function definitions///----------
def get_Idcs(path, txt_ref):
    with open(path, 'r') as file:
        Lst_txt = file.readlines()
    Lst_txt_out = []
    for txt in Lst_txt:
        Lst_data = txt.split('_')
        if Lst_data[0] == txt_ref:
            level = str(int(Lst_data[1]))
            idx_ray = str(int(Lst_data[2]))
            txt = '#'.join([level, idx_ray])
            Lst_txt_out.append(txt)
    return Lst_txt_out

def ray_shoot(ray):
    #-/Normal routine, if not valid, will be passed/-
    count = 0
    while ray.is_valid() and count < 10:
        [pt_hit, Idcs_face] = ray.forward(MESH)
        ray.reflect(MESH, pt_hit, Idcs_face)
        count += 1
    
    #-/Collect log information/-
    txt_tag = ray.get_tag()
    txt_panel = ','.join(ray.get_Idcs())
    txt_portion = ray.get_portion()
    txt_vect = ray.get_vect()
    txt = txt_tag + '_P' + txt_panel + '_%' + txt_portion + '_V' + txt_vect
    return txt

#----------///Main///----------
def Main(panel, Tags):
    if panel.is_window():
        Plcs = []
        
        #-/The original rays for reflections/-
        dict_Vects = panel.get_Vects()
        pt = panel.get_pt()
        idx = panel.get_idx()
        for tag in Tags:
            #-/Declare a new ray/-
            vect = dict_Vects[tag]
            ray = Ray(idx, pt, vect, tag, 1.0)
            #-/Ray-trace routine/-
            txt = ray_shoot(ray)
            plc = ray.get_plc()
            Plcs.append(plc)
    else:
        Plcs = []
    return Plcs

if run_it and scene and level in ['A', 'B', 'C']:
    #---/Get the system accuracy (normally 0.001)/---
    TOL = sc.doc.ModelAbsoluteTolerance
    
    #---/initialize this run/---
    MESH = scene.get_mesh()
    
    #---/Get the target panel/---
    Rays_all = []
    for path in Paths:
        Lst_txt_path = path.split('_')
        tag_panel = Lst_txt_path[-1].replace('.txt', '')
        if 'R' in tag_panel:
            virtual = False
            idx_panel = int(tag_panel.replace('R', ''))
        else:
            virtual = True
            idx_panel = int(tag_panel.replace('V', ''))
        panel = scene.get_panel_both(idx_panel, virtual)
        
        #---/Get the indices to reshoot/---
        Tags_reshoot = get_Idcs(path, level)
        
        #---/Proceed Ray-Tracing in parallel/---
        Rays = Main(panel, Tags_reshoot)
        Rays_all.extend(Rays)
# ---------- end python_19 ----------
crv = Curve(python_19.Rays_all)
